% Simulink data dictionary BMS_MAIN.sldd
% references BM_DD.sldd
% references MI_T1_DD.sldd

mi_VCU_WakeupSleepReq_E = Simulink.Signal(StorageClass="ExportedGlobal", DataType="Enum: WAKEUP_SLEEP_REQ_E")
mi_Charger_Connected_flg = Simulink.Signal(StorageClass="ExportedGlobal", DataType="boolean")
mi_CellVoltMeas_vu16 = Simulink.Signal(StorageClass="ExportedGlobal", DataType="uint16")
mi_PackTempMeas_vu16 = Simulink.Signal(StorageClass="ExportedGlobal")
mi_PackTempMeas_vf32 = Simulink.Signal(StorageClass="ExportedGlobal", DataType="single")
fm_BMS_Cutoff_flg = Simulink.Signal(StorageClass="ExportedGlobal", DataType="boolean")
mi_DiagReset_flg = Simulink.Signal(StorageClass="ExportedGlobal", DataType="boolean")
bm_BMS_MODE_E = Simulink.Signal(StorageClass="ExportedGlobal", DataType="Enum: BMS_MODES_E")
mo_BMS_ASW_Version_u32 = Simulink.Signal(StorageClass="ExportedGlobal", DataType="uint32")
mi_VCU_IGN_Sts_flg = Simulink.Signal(StorageClass="ExportedGlobal", DataType="boolean")
Configuration = Simulink.ConfigSet(StartTime="0", StopTime="10", FixedStep="0.01", Solver="FixedStepDiscrete", ProdHWDeviceType="Intel->x86-64 (Windows64)", SystemTargetFile="grt.tlc", TargetLang="C")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
mi_Charger_Connected_flg_T1 = Simulink.Signal(StorageClass="ExportedGlobal", DataType="boolean")
mi_VCU_WakeupSleepReq_E_T1 = Simulink.Signal(StorageClass="ExportedGlobal", DataType="Enum: WAKEUP_SLEEP_REQ_E")
mi_CellVoltMeas_vu16_T1 = Simulink.Signal(StorageClass="ExportedGlobal", DataType="uint16")
mi_PackTempMeas_vf32_T1 = Simulink.Signal(StorageClass="ExportedGlobal", DataType="single")
mi_DiagReset_flg_T1 = Simulink.Signal(StorageClass="ExportedGlobal", DataType="boolean")
mi_VCU_IGN_Sts_flg_T1 = Simulink.Signal(StorageClass="ExportedGlobal", DataType="boolean")
SAMPLE_TIME_10MS = Simulink.Parameter(10, DataType="uint8")